# Grasshopper definition Building Massing Generator.gh (Grasshopper 1.0.8)
# plug-ins: MetaHopper

# Inputs_02
panel = Panel("C:\Users\Hasan.Uretmen\Desktop\gsheets-453516-84036290bafd.json")
panel_2 = Panel("https://docs.google.com/spreadsheets/d/1Mp_0EnTENGw9ARAdU5YWTNqU4SqarKKLxUAZXsHsd3U/edit?pli=1&gid=0#gid=0")
# MarkUps
button = Button()
selobj = GetSelectedObjects(AllObjects_Object=button)  # -> ComponentObjects, ParamObjects, OtherObjects
active = BooleanToggle(True)
eml_core_width = Panel("15")
eml_core_center = Panel("25,25,0")
eml_core_length = Panel("15")
eml_core_rot = Panel("0")
eml_building_height = Panel("100")
eml_number_of_floors = Panel("25")
# Preview
# Bake
# Inputs_01
eml_pts = Panel("0,0,0,0,50,0,50,50,0,50,0,0")
eml_floor_to_floor = Panel("4")
gh_selection_to_markups = CSharpScript(Run=button)  # -> out, MarkUp, Frames, Frames_loc; inputs Run: Boolean
# ---------- gh_selection_to_markups: C# ----------
    if (Run)
    {
      List<Plane> plns = new List<Plane>();
      List<Rectangle3d> myBounds = new List<Rectangle3d>();
      List<Grasshopper.Kernel.Special.GH_Markup> MarkUps = new List<Grasshopper.Kernel.Special.GH_Markup>();

      var myGroup = new Grasshopper.Kernel.Special.GH_Group();

      foreach (IGH_DocumentObject obj in GrasshopperDocument.Objects)
      {
        //List<IGH_DocumentObject> tempList = new List<IGH_DocumentObject>();

        if (obj.Attributes.Selected == true)
        {
          Guid g = obj.InstanceGuid;
          Print(g.ToString());
          myGroup.AddObject(g);
        }
      }

      Print(myGroup.ComponentGuid.ToString());
      IGH_DocumentObject gi = myGroup as IGH_DocumentObject;
      GrasshopperDocument.AddObject(gi, false, 2147483647);

      double marginX = 40;
      double marginY = 40;
      double sizeX = gi.Attributes.Bounds.Width;
      double sizeY = gi.Attributes.Bounds.Height;
      double locX = gi.Attributes.Bounds.Location.X;
      double locY = gi.Attributes.Bounds.Location.Y;

      sizeX += marginX;
      sizeY += marginY;
      locX -= 0.5 * marginX;
      locY -= 0.5 * marginY;
      Print(sizeX.ToString());
      Plane pln = new Plane(new Point3d(locX, -locY, 0.0), Vector3d.ZAxis);
      Rectangle3d bnd = new Rectangle3d(pln, sizeX, -sizeY);
      plns.Add(pln);
      myBounds.Add(bnd);
      GrasshopperDocument.RemoveObject(gi, false);

      var myMarkup = new Grasshopper.Kernel.Special.GH_Markup();

      IGH_DocumentObject mi = myMarkup  as IGH_DocumentObject;
      GrasshopperDocument.AddObject(mi, false, 247483447);

      PointF mLoc = new PointF((float) locX, (float) locY);
      System.Drawing.SizeF s = new System.Drawing.SizeF((float) sizeX, (float) sizeY);

      System.Drawing.RectangleF myF = new System.Drawing.RectangleF(mLoc, s);
      System.Drawing.Rectangle myR = new System.Drawing.Rectangle((int) locX, (int) locY, (int) sizeX, (int) sizeY);
      mi.Attributes.Bounds = myF;
      mi.Attributes.Pivot = mLoc;


      //if (mi == null) continue;
      MarkUps.Add(myMarkup);

      //}
      Frames_loc = plns;
      Frames = myBounds;
      MarkUp = MarkUps[0];
    }
# ---------- end gh_selection_to_markups ----------
keyslider = KeyboardSlider(button=selobj.ParamObjects, active=active)  # inputs active: Boolean
# ---------- keyslider: C# usings ----------
using System.Windows.Forms;
using Grasshopper.Kernel.Special;
# ---------- keyslider: C# ----------
    _btn = (GH_ButtonObject) button;
    Instances.DocumentEditor.KeyDown -= new KeyEventHandler(KeyDownEventHandler);
    Instances.DocumentEditor.KeyUp -= new KeyEventHandler(KeyUpEventHandler);
    if(active)
    {
      Instances.DocumentEditor.KeyDown += new KeyEventHandler(KeyDownEventHandler);
      Instances.DocumentEditor.KeyUp += new KeyEventHandler(KeyUpEventHandler);
    }
# ---------- keyslider: C# additional code ----------
  GH_ButtonObject _btn;
  void KeyDownEventHandler(object sender, KeyEventArgs e)
  {
    if(e.KeyCode != Keys.F7 || _btn.ButtonDown) return;
    _btn.ButtonDown = true;
    _btn.ExpireSolution(true);
  }
  void KeyUpEventHandler(object sender, KeyEventArgs e)
  {
    if(e.KeyCode != Keys.F7 || !_btn.ButtonDown) return;
    _btn.ButtonDown = false;
    _btn.ExpireSolution(true);
  }
# ---------- end keyslider ----------
fillet = Fillet(Curve=gh_selection_to_markups.Frames, Radius=Slider(30, range=0..40))
core_brep_parent_layer = Data("01_INPUT::CORE_BREP")
cell_range_to_write = Data("D1:F100")
cell_range_to_read = Data("A1:C100")
set_sketch = SetSketch(Sketch=gh_selection_to_markups.MarkUp, SketchShapes=fillet)
wiredisplay = ControlWireDisplay(WireDisplay=2)
worksheet_name = Data("Sheet1")
credentials_path = Data(panel)
url = Data(panel_2)

# ---- group: Initial_Plane
# Building Massing Generator
# Parameters
# Index
# Parameters
initial_plane_rotation_angle = Slider(0, range=-360..360)
# Initial_Setup
initial_plane_rotation_angle_2 = Number(initial_plane_rotation_angle)

# ---- group: Massing_&_Core_Options
# Initial_Setup
massing_option_number = Slider(1, range=1..10)
core_option_number = Slider(1, range=1..10)
massing_option_number_2 = Number(massing_option_number)
core_option_number_2 = Number(core_option_number)

# ---- group: Plan_Grid
# Floor_&_Program_Info
plan_grid_column_count = Slider(5, range=0..10)
# Grid_Curves_&_Surfaces
move_plan_grid_x_axis = Slider(100, range=-1000..1000)
move_plan_grid_y_axis = Slider(50, range=-1000..1000)
# Areas
plan_grid_rectangle_x_size = Slider(200, range=0..200)
# Google_Sheets_Writer
plan_grid_rectangle_y_size = Slider(100, range=0..100)
plan_grid_rectangle_x_size_2 = Number(plan_grid_rectangle_x_size)
plan_grid_rectangle_y_size_2 = Number(plan_grid_rectangle_y_size)
plan_grid_column_count_2 = Number(plan_grid_column_count)
move_plan_grid_x_axis_2 = Number(move_plan_grid_x_axis)
move_plan_grid_y_axis_2 = Number(move_plan_grid_y_axis)

# ---- group: Text
text_margin = Slider(5, range=0..10)
# Text
text_height = Slider(2, range=0..100)
text_margin_2 = Number(text_margin)
text_height_2 = Number(text_height)

# ---- group: Rounding
# Hatch
decimal_place_count_for_rounding_areas = Slider(0, range=0..5)
# Dimensions
decimal_place_count_for_rounding_efficie = Slider(1, range=0..5)  # "Decimal_Place_Count_for_Rounding_Efficiency"
decimal_place_count_for_rounding_efficie_2 = Number(decimal_place_count_for_rounding_efficie)  # "Decimal_Place_Count_for_Rounding_Efficiency"
decimal_place_count_for_rounding_areas_2 = Number(decimal_place_count_for_rounding_areas)

# ---- group: Dimensions
dimension_plane_rotation_angle = Slider(0, range=-60..100)
dim_01_shifting_distance = Slider(0, range=-50..50)
dim_02_shifting_distance = Slider(0, range=-50..50)
dimension_plane_rotation_angle_2 = Number(dimension_plane_rotation_angle)
dim_01_shifting_distance_2 = Number(dim_01_shifting_distance)
dim_02_shifting_distance_2 = Number(dim_02_shifting_distance)

# ----
split = TextSplit(Text=eml_core_center, Separators=",")
split_2 = TextSplit(Text=eml_pts, Separators=",")
partition = PartitionList(List=split, Size="3")  # -> simplify(Chunks)
partition_2 = PartitionList(List=split_2, Size="3")  # -> simplify(Chunks)
item = ListItem(List=partition, Index=0, Wrap=True)  # -> Item, Item1, Item2
item_2 = ListItem(List=partition_2, Index=0, Wrap=True)  # -> Item, Item1, Item2
pt = ConstructPoint(XCoordinate=item.Item, YCoordinate=item.Item1, ZCoordinate=item.Item2)
pt_2 = ConstructPoint(XCoordinate=item_2.Item, YCoordinate=item_2.Item1, ZCoordinate=item_2.Item2)  # -> flatten(Point)
eml_pts_2 = Point(pt_2)
eml_core_width_2 = Number(eml_core_width)
eml_core_length_2 = Number(eml_core_length)
eml_core_rot_2 = Number(eml_core_rot)
eml_building_height_2 = Number(eml_building_height)
eml_number_of_floors_2 = Number(eml_number_of_floors)
eml_floor_to_floor_2 = Number(eml_floor_to_floor)
eml_core_center_2 = Plane(pt)
worksheet_name_2 = Data(worksheet_name)
cell_range = Data(cell_range_to_read)
url_2 = Data(url)
# Floor_&_Program_Info
# Floor_Heights_(Google_Sheets_Reader)
credentials_path_2 = Data(credentials_path)
initial_plane_rotation_angle_3 = Number(initial_plane_rotation_angle_2)
# Core_Rectangle
core_rot = Number(eml_core_rot_2)
core_center = Plane(eml_core_center_2)
core_width = Number(eml_core_width_2)
core_length = Number(eml_core_length_2)
# Massing_Brep
pts = Point(eml_pts_2)
building_height = Number(eml_building_height_2)
building_height_2 = Number(eml_building_height_2)
core_rot_2 = Number(eml_core_rot_2)
# Floor_Elevations
floor_to_floor = Number(eml_floor_to_floor_2)
number_of_floors = Number(eml_number_of_floors_2)
hull2d = ConvexHull(Points=pts, Plane=PlaneXY(0, 0, 0))  # -> Hull, HullZ, Indices
Z = UnitZ(Factor=building_height)
Z_2 = UnitZ(Factor=building_height_2)
google_sheets_reader = Python3Script(credentials_path=credentials_path_2, url=url_2, worksheet_name=worksheet_name_2, cell_range=cell_range)  # -> data_tree, cell_color_tree; inputs credentials_path: String, url: String, worksheet_name: String, cell_range: String
# ---------- google_sheets_reader: Python ----------
#r: gspread
#r: google-api-python-client
#r: google-auth
#r: google-auth-oauthlib
#r: google-auth-httplib2
#r: requests
#r: gspread-formatting

import re
import gspread
from google.oauth2.service_account import Credentials
from googleapiclient.discovery import build

from Grasshopper import DataTree
from Grasshopper.Kernel.Data import GH_Path

import gspread.utils

def normalized_to_rgb(color):
    """
    Convert a color with normalized values (0 to 1) to a string in "R,G,B" format.
    Color is expected to be a dictionary.
    """
    if not color:
        return None
    try:
        r = float(color.get('red', 0))
        g = float(color.get('green', 0))
        b = float(color.get('blue', 0))
    except AttributeError:
        r = getattr(color, 'red', 0)
        g = getattr(color, 'green', 0)
        b = getattr(color, 'blue', 0)
    r = int(round(r * 255))
    g = int(round(g * 255))
    b = int(round(b * 255))
    return f"{r},{g},{b}"

try:
    # Extract the sheet ID from the provided URL.
    # Example URL: https://docs.google.com/spreadsheets/d/1a2B3cD4eF5Gh6I7j8K9L0mnopQRstuV/edit#gid=0
    match = re.search(r'/d/([a-zA-Z0-9-_]+)', url)
    if match:
        sheet_id = match.group(1)
    else:
        raise Exception("Could not extract sheet id from URL.")
    
    # Define the scope and create credentials.
    scope = ["https://spreadsheets.google.com/feeds",
             "https://www.googleapis.com/auth/drive"]
    creds = Credentials.from_service_account_file(credentials_path, scopes=scope)
    
    # Authorize the gspread client and open the worksheet.
    client = gspread.authorize(creds)
    spreadsheet = client.open_by_key(sheet_id)
    worksheet = spreadsheet.worksheet(worksheet_name)
    
    # Retrieve raw cell values (one API call).
    raw_data = worksheet.get(cell_range)
    
    if raw_data and len(raw_data) > 0:
        # Determine the maximum number of columns.
        max_cols = max(len(row) for row in raw_data)
        
        # Transpose raw_data so that each branch represents a column.
        flipped = []
        for col in range(max_cols):
            col_data = []
            for row in raw_data:
                col_data.append(row[col] if col < len(row) else "")
            flipped.append(col_data)
        
        # Build the DataTree for cell values.
        value_tree = DataTree[object]()
        for col_index, col in enumerate(flipped):
            for row_index, value in enumerate(col):
                path = GH_Path(col_index, row_index)
                value_tree.Add(value, path)
        
        # Use the Sheets API to batch get formatting for the specified range.
        service = build('sheets', 'v4', credentials=creds)
        formatting_response = service.spreadsheets().get(
            spreadsheetId=sheet_id,
            ranges=[cell_range],
            fields="sheets(data(rowData(values(userEnteredFormat(backgroundColor)))))"
        ).execute()
        
        # Parse the formatting response.
        sheets = formatting_response.get("sheets", [])
        if sheets:
            data_section = sheets[0].get("data", [])
            if data_section:
                row_data = data_section[0].get("rowData", [])
            else:
                row_data = []
        else:
            row_data = []
        
        # Build a color matrix matching raw_data dimensions.
        color_matrix = []
        for row_index in range(len(raw_data)):
            row_colors = []
            if row_index < len(row_data):
                row_info = row_data[row_index]
                cells = row_info.get("values", [])
            else:
                cells = []
            for col_index in range(max_cols):
                if col_index < len(cells):
                    cell = cells[col_index]
                    user_format = cell.get("userEnteredFormat", {})
                    bg_color = user_format.get("backgroundColor", None)
                    rgb_color = normalized_to_rgb(bg_color) if bg_color else None
                else:
                    rgb_color = None
                row_colors.append(rgb_color)
            color_matrix.append(row_colors)
        
        # Transpose the color matrix to match the structure of value_tree (columns as branches).
        transposed_color = []
        for col in range(max_cols):
            col_colors = []
            for row in range(len(color_matrix)):
                col_colors.append(color_matrix[row][col])
            transposed_color.append(col_colors)
        
        # Build the DataTree for cell colors.
        color_tree = DataTree[object]()
        for col_index, col in enumerate(transposed_color):
            for row_index, color in enumerate(col):
                path = GH_Path(col_index, row_index)
                color_tree.Add(color, path)
        
        # Set the outputs.
        data_tree = value_tree
        cell_color_tree = color_tree
    else:
        data_tree = "No data found. Check your cell_range or sheet content."
        cell_color_tree = "No data found. Check your cell_range or sheet content."
    
except Exception as e:
    data_tree = "Error: " + str(e)
    cell_color_tree = "Error: " + str(e)
# ---------- end google_sheets_reader ----------
division = Division(A=core_width, B="2")
division_2 = Division(A=core_length, B="2")
neg = Negative(Value=initial_plane_rotation_angle_3)
series = Series(Start=0, Step=floor_to_floor, Count=number_of_floors)
crv = Curve(hull2d.Hull)
rotate = Rotate(Geometry=core_center, Angle=core_rot, Plane=core_center)  # -> Geometry, Transform
neg_2 = Negative(Value=division)
neg_3 = Negative(Value=division_2)
floor_elevations = Number(series)
floor_elevations_2 = Number(floor_elevations)
Z_3 = UnitZ(Factor=floor_elevations_2)
dom = ConstructDomain(DomainStart=neg_2, DomainEnd=division)
dom_2 = ConstructDomain(DomainStart=neg_3, DomainEnd=division_2)
extr = Extrude(Base=crv, Direction=Z)
trim = TrimTree(Tree=google_sheets_reader.data_tree, Depth=1)
trim_2 = TrimTree(Tree=google_sheets_reader.cell_color_tree, Depth=1)
rectangle = Rectangle(Plane=rotate.Geometry, XSize=dom, YSize=dom_2, Radius=0)  # -> Rectangle, Length
edges = BrepEdges(Brep=extr)  # -> Naked, Interior, NonManifold
cull_i = CullIndex(List=trim_2, Indices="0", Wrap=True)  # -> simplify(List)
core_rectangle = Curve(rectangle.Rectangle)
# Core_Brep
core_rectangle_2 = Curve(core_rectangle)
extr_2 = Extrude(Base=core_rectangle_2, Direction=Z_2)
cap = CapHoles(Brep=extr_2)
core_brep = Brep(cap)
crv_2 = Curve(edges.Naked)
cull_i_2 = CullIndex(List=trim, Indices="0", Wrap=True)  # -> simplify(List)
bang = ExplodeTree(Data=cull_i)  # -> Branch0, Branch1, Branch2
join = JoinCurves(Curves=crv_2, Preserve=False)
bang_2 = ExplodeTree(Data=cull_i_2)  # -> Branch0, Branch1, Branch2
area = Area(Geometry=join)  # -> Area, Centroid
pdecon = Deconstruct(Point=area.Centroid)  # -> XComponent, YComponent, ZComponent
sort = SortList(Keys=pdecon.ZComponent, ValuesA=join)  # -> Keys, ValuesA
number_of_floors_2 = Number(eml_number_of_floors_2)
item_3 = ListItem(List=reverse(sort.ValuesA), Index=0, Wrap=True)
boundary = BoundarySurfaces(Edges=item_3)
repeat = RepeatData(Data="Default_Program", Length=number_of_floors_2)
program_colors = Data(ColourSwatch(SwatchColor=RGB(0, 119, 255)))
merge = Merge(Data1=extr, Data2=boundary)  # -> flatten(Result)
program = Data(repeat)
join_2 = BrepJoin(Breps=merge)  # -> Breps, Closed
# Program_Colors_Sorted
program_colors_2 = Data(program_colors)
# Program_Name_Sorted
program_2 = Data(program)
massing_brep = Brep(join_2.Breps)
# Brep_Center_Pt
massing_brep_2 = Brep(massing_brep)
cap_2 = CapHoles(Brep=massing_brep_2)
debrep = DeconstructBrep(Brep=cap_2)  # -> Faces, Edges, Vertices
area_2 = Area(Geometry=debrep.Faces)  # -> Area, Centroid
pdecon_2 = Deconstruct(Point=area_2.Centroid)  # -> XComponent, YComponent, ZComponent
sort_2 = SortList(Keys=pdecon_2.ZComponent, ValuesA=debrep.Faces)  # -> Keys, ValuesA
item_4 = ListItem(List=sort_2.ValuesA, Index=0, Wrap=True)
area_3 = Area(Geometry=item_4)  # -> Area, Centroid
brep_center_pt = Point(area_3.Centroid)
# Initial_Plane
brep_center_pt_2 = Point(brep_center_pt)
pl = ConstructPlane(Origin=brep_center_pt_2, XAxis=Vector(1, 0, 0), YAxis=Vector(0, 1, 0))
rotate_2 = Rotate(Geometry=pl, Angle=degrees(core_rot_2), Plane=pl)  # -> Geometry, Transform
initial_plane = Plane(rotate_2.Geometry)
# Floor_Planes
initial_plane_2 = Plane(initial_plane)
rotate_3 = Rotate(Geometry=initial_plane_2, Angle=degrees(neg), Plane=PlaneXY(0, 0, 0))  # -> Geometry, Transform
move = Move(Geometry=rotate_3.Geometry, Motion=Z_3)  # -> simplify(graft(Geometry)), Transform
floor_planes = Plane(move.Geometry)
cset = CreateSet(List=program_2)  # -> Set, Map
cset_2 = CreateSet(List=program_colors_2)  # -> Set, Map
mindex = MemberIndex(Set=simplify(program_2), Member=simplify(cset.Set))  # -> simplify(Index), Count
mindex_2 = MemberIndex(Set=simplify(program_colors_2), Member=simplify(cset_2.Set))  # -> simplify(Index), Count
item_5 = ListItem(List=program_2, Index=mindex.Index, Wrap=True)
item_6 = ListItem(List=program_colors_2, Index=mindex_2.Index, Wrap=True)
program_name_sorted = Data(item_5)
program_colors_sorted = Data(item_6)
program_index = Data(mindex.Index)
massing_brep_3 = Brep(massing_brep)
initial_plane_3 = Plane(initial_plane)
floor_elevations_3 = Number(floor_elevations)
floor_planes_2 = Plane(floor_planes)
xy = XYPlane(Origin=Point(0, 0, 0))
move_plan_grid_x_axis_3 = Number(move_plan_grid_x_axis_2)
move_plan_grid_y_axis_3 = Number(move_plan_grid_y_axis_2)
plan_grid_rectangle_x_size_3 = Number(plan_grid_rectangle_x_size_2)
plan_grid_column_count_3 = Number(plan_grid_column_count_2)
plan_grid_rectangle_y_size_3 = Number(plan_grid_rectangle_y_size_2)
# Grid_Curves_&_Surfaces
# Plan_Grid_Cells
# Plan_Grid_Planes
initial_plane_4 = Plane(initial_plane)
# Massing_Plan_Crv
# Massing_Plan_Crv_On_Grid
initial_plane_5 = Plane(initial_plane)
number_of_floors_3 = Number(eml_number_of_floors_2)
initial_plane_6 = Plane(initial_plane)
floor_planes_3 = Plane(floor_planes)
core_brep_2 = Brep(core_brep)
floor_elevations_4 = Number(floor_elevations)
# Efficiency
decimal_place_count_for_rounding_efficie_3 = Number(decimal_place_count_for_rounding_efficie_2)  # "Decimal_Place_Count_for_Rounding_Efficiency"
# Gross_Floor_Area_Rounded
decimal_place_count_for_rounding_areas_3 = Number(decimal_place_count_for_rounding_areas_2)
# Core_Area_Rounded
decimal_place_count_for_rounding_areas_4 = Number(decimal_place_count_for_rounding_areas_2)
program_index_2 = Data(program_index)
contour = ContourEx(Shape=massing_brep_3, Plane=initial_plane_3, Offsets=floor_elevations_3)  # -> simplify(Contours)
project = Project(Geometry=initial_plane_4, Plane=xy)  # -> Geometry, Transform
X = UnitX(Factor=move_plan_grid_x_axis_3)
contour_2 = ContourEx(Shape=core_brep_2, Plane=initial_plane_6, Offsets=floor_elevations_4)  # -> simplify(Contours)
Y = UnitY(Factor=move_plan_grid_y_axis_3)
addition = Addition(A=X, B=Y)
item_7 = ListItem(List=contour_2, Index=0, Wrap=True)
item_8 = ListItem(List=contour, Index=0, Wrap=True)
division_3 = Division(A=number_of_floors_3, B=plan_grid_column_count_3)
move_2 = Move(Geometry=project.Geometry, Motion=addition)  # -> Geometry, Transform
series_2 = Series(Start="0", Step="0", Count=decimal_place_count_for_rounding_areas_3)
series_3 = Series(Start="0", Step="0", Count=decimal_place_count_for_rounding_areas_4)
cls = Closed(Curve=item_8)  # -> Closed, Periodic
cls_2 = Closed(Curve=item_7)  # -> Closed, Periodic
series_4 = Series(Start=0, Step=1, Count=number_of_floors_3)
round = Round(Number=division_3)  # -> Nearest, Floor, Ceiling
join_3 = TextJoin(Text=series_2)
join_4 = TextJoin(Text=series_3)
_10º = PowerOf10(Value=decimal_place_count_for_rounding_areas_3)
_10º_2 = PowerOf10(Value=decimal_place_count_for_rounding_areas_4)
series_5 = Series(Start="0", Step="0", Count=decimal_place_count_for_rounding_efficie_3)
cull = CullPattern(List=item_8, CullPattern=invert(cls.Closed))
cull_2 = CullPattern(List=item_7, CullPattern=invert(cls_2.Closed))
cull_3 = CullPattern(List=item_8, CullPattern=cls.Closed)
cull_4 = CullPattern(List=item_7, CullPattern=cls_2.Closed)
join_5 = TextJoin(Text=series_5)
neg_4 = Negative(Value=plan_grid_rectangle_y_size_3)
_10º_3 = PowerOf10(Value=decimal_place_count_for_rounding_efficie_3)
crv_3 = Curve(cull)
clean = CleanTree(RemoveNulls=True, RemoveInvalid=True, RemoveEmpty=True, Tree=item_8)
clean_2 = CleanTree(RemoveNulls=True, RemoveInvalid=True, RemoveEmpty=True, Tree=cull_3)
crv_4 = Curve(cull_2)
clean_3 = CleanTree(RemoveNulls=True, RemoveInvalid=True, RemoveEmpty=True, Tree=item_7)
clean_4 = CleanTree(RemoveNulls=True, RemoveInvalid=True, RemoveEmpty=True, Tree=cull_4)
cbr = CurveBooleanRegions(C=crv_3, P=crv_3, B="0", T="0.001")  # -> simplify(R); inputs C: list of Curve, P: Plane, B: Boolean, T: Double
# ---------- cbr: Python ----------
import Rhino.Geometry as rg

# Set component metadata
ghenv.Component.Name = "Curve Boolean Regions"
ghenv.Component.NickName = "CBR"
ghenv.Component.Description = "Generates boolean regions from a set of curves on a plane and outputs all region curves."

# Set input parameter details:
# Input 0: Curves (C)
ghenv.Component.Params.Input[0].Name = "Curves"
ghenv.Component.Params.Input[0].NickName = "C"
ghenv.Component.Params.Input[0].Description = "List of curves to create boolean regions from."

# Input 1: Plane (P)
ghenv.Component.Params.Input[1].Name = "Plane"
ghenv.Component.Params.Input[1].NickName = "P"
ghenv.Component.Params.Input[1].Description = "Plane on which the boolean operation is performed."

# Input 2: Combine (B)
ghenv.Component.Params.Input[2].Name = "Boolean Union"
ghenv.Component.Params.Input[2].NickName = "B"
ghenv.Component.Params.Input[2].Description = "Flag indicating whether to perform a boolean union of curves."

# Input 3: Tolerance (T)
ghenv.Component.Params.Input[3].Name = "Tolerance"
ghenv.Component.Params.Input[3].NickName = "T"
ghenv.Component.Params.Input[3].Description = "Tolerance value for creating boolean regions."

# Set output parameter details:
# Output 0: Regions (R)
ghenv.Component.Params.Output[0].Name = "Regions"
ghenv.Component.Params.Output[0].NickName = "R"
ghenv.Component.Params.Output[0].Description = "All curves generated from the boolean regions."

# --- Main Code ---

# Create the boolean regions object
booleanRegions = rg.Curve.CreateBooleanRegions(C, P, B, T)

R = []
# Iterate over all region indices using the RegionCount property
for i in range(booleanRegions.RegionCount):
    R.extend(booleanRegions.RegionCurves(i))
# ---------- end cbr ----------
rectangle_2 = Rectangle(Plane=move_2.Geometry, XSize=plan_grid_rectangle_x_size_3, YSize=neg_4, Radius=0)  # -> Rectangle, Length
deplane = DeconstructPlane(Plane=project.Geometry)  # -> Origin, XAxis, YAxis, ZAxis
cbr_2 = CurveBooleanRegions(C=crv_4, P=crv_4, B="0", T="0.001")  # -> simplify(R); inputs C: list of Curve, P: Plane, B: Boolean, T: Double; same code as cbr
tstat = TreeStatistics(Tree=clean_3)  # -> Paths, Length, Count
tstat_2 = TreeStatistics(Tree=clean_4)  # -> Paths, Length, Count
tstat_3 = TreeStatistics(Tree=clean)  # -> Paths, Length, Count
tstat_4 = TreeStatistics(Tree=clean_2)  # -> Paths, Length, Count
clean_5 = CleanTree(RemoveNulls=True, RemoveInvalid=True, RemoveEmpty=True, Tree=cbr)
series_6 = Series(Start=0, Step=plan_grid_rectangle_x_size_3, Count=plan_grid_column_count_3)
series_7 = Series(Start=0, Step=plan_grid_rectangle_y_size_3, Count=round.Ceiling)
clean_6 = CleanTree(RemoveNulls=True, RemoveInvalid=True, RemoveEmpty=True, Tree=cbr_2)
tstat_5 = TreeStatistics(Tree=clean_5)  # -> Paths, Length, Count
amp = Amplitude(Vector=deplane.XAxis, Amplitude=series_6)
tstat_6 = TreeStatistics(Tree=clean_6)  # -> Paths, Length, Count
amp_2 = Amplitude(Vector=deplane.YAxis, Amplitude=series_7)
dpath = DeconstructPath(Branch=tstat_5.Paths)
concat = Concatenate(FragmentA="{0:0.", FragmentB=join_3, FragmentC="}")
concat_2 = Concatenate(FragmentA="{0:0.", FragmentB=join_4, FragmentC="}")
dpath_2 = DeconstructPath(Branch=tstat_6.Paths)
move_3 = Move(Geometry=rectangle_2.Rectangle, Motion=amp)  # -> Geometry, Transform
neg_5 = Negative(Value=amp_2)
addition_2 = Addition(A="1", B=dpath)
addition_3 = Addition(A="1", B=dpath_2)
concat_3 = Concatenate(FragmentA="{0:0.", FragmentB=join_5, FragmentC="}")
move_4 = Move(Geometry=graft(move_3.Geometry), Motion=neg_5)  # -> Geometry, Transform
path = ConstructPath(Indices=addition_2)
path_2 = ConstructPath(Indices=addition_3)
deplane_2 = DeconstructPlane(Plane=initial_plane_5)  # -> Origin, XAxis, YAxis, ZAxis
flip = FlipMatrix(Data=move_4.Geometry)  # -> simplify(Data)
branch = TreeBranch(Tree=cull_3, Path=path, MaintainPaths=True)
branch_2 = TreeBranch(Tree=cull_4, Path=path_2, MaintainPaths=True)
area_4 = Area(Geometry=branch)  # -> Area, Centroid
area_5 = Area(Geometry=branch_2)  # -> Area, Centroid
area_6 = Area(Geometry=clean_6)  # -> Area, Centroid
area_7 = Area(Geometry=clean_5)  # -> Area, Centroid
area_8 = Area(Geometry=flip)  # -> Area, Centroid
flatten = FlattenTree(Tree=area_8.Centroid, Path="{0}")  # -> graft(Tree)
subtraction = Subtraction(A=area_4.Area, B=area_7.Area)
subtraction_2 = Subtraction(A=area_5.Area, B=area_6.Area)
pl_2 = ConstructPlane(Origin=flatten, XAxis=deplane_2.XAxis, YAxis=deplane_2.YAxis)
abs = Absolute(Value=subtraction)
abs_2 = Absolute(Value=subtraction_2)
item_9 = ListItem(List=flatten(flip), Index=series_4, Wrap=True)  # -> simplify(graft(Item))
item_10 = ListItem(List=flatten(pl_2), Index=series_4, Wrap=True)  # -> simplify(graft(Item))
smaller = SmallerThan(FirstNumber=abs, SecondNumber="0.0000001")  # -> SmallerThan, OrEqualTo
smaller_2 = SmallerThan(FirstNumber=abs_2, SecondNumber="0.0000001")  # -> SmallerThan, OrEqualTo
cull_5 = CullPattern(List=clean_5, CullPattern=smaller.SmallerThan)
cull_6 = CullPattern(List=clean_6, CullPattern=smaller_2.SmallerThan)
plan_grid_cells = Curve(item_9)
plan_grid_planes = Plane(item_10)
# Core_Plan_Crv
# Core_Plan_Crv_On_Grid
plan_grid_planes_2 = Plane(plan_grid_planes)
plan_grid_planes_3 = Plane(plan_grid_planes)
merge_2 = Merge(Data1=cull_3, Data2=cull_5)
larger = LargerThan(FirstNumber=tstat.Count, SecondNumber=tstat_2.Count)  # -> LargerThan, OrEqualTo
larger_2 = LargerThan(FirstNumber=tstat_3.Count, SecondNumber=tstat_4.Count)  # -> LargerThan, OrEqualTo
merge_3 = Merge(Data1=cull_4, Data2=cull_6)
cull_7 = CullPattern(List=item_7, CullPattern=invert(larger.LargerThan))
cull_8 = CullPattern(List=item_8, CullPattern=invert(larger_2.LargerThan))
cull_9 = CullPattern(List=merge_3, CullPattern=larger.LargerThan)
cull_10 = CullPattern(List=merge_2, CullPattern=larger_2.LargerThan)
merge_4 = Merge(Data1=cull_7, Data2=cull_9)
merge_5 = Merge(Data1=cull_8, Data2=cull_10)
lng = ListLength(List=massing_brep_3)
lng_2 = ListLength(List=core_brep_2)
path_mapper = PathMapper(merge_4, source="{A;B}", target="{B;A}")
path_mapper_2 = PathMapper(merge_5, source="{A;B}", target="{B;A}")
larger_3 = LargerThan(FirstNumber="1", SecondNumber=lng)  # -> LargerThan, OrEqualTo
larger_4 = LargerThan(FirstNumber="1", SecondNumber=lng_2)  # -> LargerThan, OrEqualTo
trim_3 = TrimTree(Tree=path_mapper, Depth=1)
trim_4 = TrimTree(Tree=path_mapper_2, Depth=1)
cull_11 = CullPattern(List=trim_3, CullPattern=invert(flatten(larger_4.OrEqualTo)))
cull_12 = CullPattern(List=merge_4, CullPattern=flatten(larger_4.OrEqualTo))
cull_13 = CullPattern(List=trim_4, CullPattern=invert(flatten(larger_3.OrEqualTo)))
cull_14 = CullPattern(List=merge_5, CullPattern=flatten(larger_3.OrEqualTo))
merge_6 = Merge(Data1=cull_12, Data2=cull_11)
merge_7 = Merge(Data1=cull_14, Data2=cull_13)
clean_7 = CleanTree(RemoveNulls=True, RemoveInvalid=True, RemoveEmpty=True, Tree=merge_6)
clean_8 = CleanTree(RemoveNulls=True, RemoveInvalid=True, RemoveEmpty=True, Tree=merge_7)
orient = Orient(Geometry=clean_7, Source=floor_planes_3, Target=simplify(plan_grid_planes_3))  # -> Geometry, Transform
orient_2 = Orient(Geometry=clean_8, Source=floor_planes_2, Target=simplify(plan_grid_planes_2))  # -> Geometry, Transform
core_plan_crv_on_grid = Curve(orient.Geometry)
# Core_Area
core_plan_crv_on_grid_2 = Curve(core_plan_crv_on_grid)
area_9 = Area(Geometry=core_plan_crv_on_grid_2)  # -> Area, Centroid
ma = MassAddition(Input=area_9.Area)  # -> Result, PartialResults
core_area = Number(ma.Result)
core_area_2 = Number(core_area)
core_area_3 = Number(core_area)
multiplication = Multiplication(A=core_area_3, B=_10º_2)
round_2 = Round(Number=multiplication)  # -> Nearest, Floor, Ceiling
division_4 = Division(A=round_2.Nearest, B=_10º_2)
format = Format(Format=concat_2, Culture=127, Data0=division_4)  # -> simplify(Text)
core_area_rounded = Data(format)
core_plan_crv = Curve(clean_7)
massing_plan_crv_on_grid = Curve(orient_2.Geometry)
# Gross_Floor_Area
massing_plan_crv_on_grid_2 = Curve(massing_plan_crv_on_grid)
area_10 = Area(Geometry=massing_plan_crv_on_grid_2)  # -> Area, Centroid
ma_2 = MassAddition(Input=area_10.Area)  # -> Result, PartialResults
gross_floor_area = Number(ma_2.Result)
gross_floor_area_2 = Number(gross_floor_area)
gross_floor_area_3 = Number(gross_floor_area)
subtraction_3 = Subtraction(A=gross_floor_area_2, B=core_area_2)
division_5 = Division(A=subtraction_3, B=gross_floor_area_2)
multiplication_2 = Multiplication(A=division_5, B="100")
multiplication_3 = Multiplication(A=gross_floor_area_3, B=_10º)
multiplication_4 = Multiplication(A=multiplication_2, B=_10º_3)
round_3 = Round(Number=multiplication_3)  # -> Nearest, Floor, Ceiling
round_4 = Round(Number=multiplication_4)  # -> Nearest, Floor, Ceiling
division_6 = Division(A=round_3.Nearest, B=_10º)
division_7 = Division(A=round_4.Nearest, B=_10º_3)
format_2 = Format(Format=concat, Culture=127, Data0=division_6)  # -> simplify(Text)
format_3 = Format(Format=concat_3, Culture=127, Data0=division_7)  # -> simplify(Text)
gross_floor_area_rounded = Data(format_2)
efficiency = Data(format_3)
massing_plan_crv = Curve(clean_8)
# Areas
# Massing_Plan_Crv_Sorted
massing_plan_crv_2 = Curve(massing_plan_crv)
group = Group(Geometry=massing_plan_crv_2)
item_11 = ListItem(List=flatten(group), Index=program_index_2, Wrap=True)
ungroup = Ungroup(Group=item_11)
trim_5 = TrimTree(Tree=ungroup, Depth=1)
massing_plan_crv_sorted = Curve(trim_5)
# Massing_Plan_Srf_Sorted
massing_plan_crv_sorted_2 = Curve(massing_plan_crv_sorted)
boundary_2 = BoundarySurfaces(Edges=massing_plan_crv_sorted_2)
massing_plan_srf_sorted = Surface(boundary_2)
dimension_plane_rotation_angle_3 = Number(dimension_plane_rotation_angle_2)
dim_01_shifting_distance_3 = Number(dim_01_shifting_distance_2)
dim_02_shifting_distance_3 = Number(dim_02_shifting_distance_2)
# Plane_X
# Plane_Y
plan_grid_planes_4 = Plane(plan_grid_planes)
rotate_4 = Rotate(Geometry=plan_grid_planes_4, Angle=dimension_plane_rotation_angle_3, Plane=plan_grid_planes_4)  # -> Geometry, Transform
deplane_3 = DeconstructPlane(Plane=rotate_4.Geometry)  # -> Origin, XAxis, YAxis, ZAxis
pl_3 = ConstructPlane(Origin=deplane_3.Origin, XAxis=deplane_3.XAxis, YAxis=deplane_3.ZAxis)
pl_4 = ConstructPlane(Origin=deplane_3.Origin, XAxis=deplane_3.ZAxis, YAxis=deplane_3.YAxis)
amp_3 = Amplitude(Vector=deplane_3.YAxis, Amplitude=dim_01_shifting_distance_3)
amp_4 = Amplitude(Vector=deplane_3.XAxis, Amplitude=dim_02_shifting_distance_3)
# Google_Sheets_Writer
# Google_Sheets_Writer
credentials_path_3 = Data(credentials_path)
url_3 = Data(url)
worksheet_name_3 = Data(worksheet_name)
cell_range_2 = Data(cell_range_to_write)
gross_floor_area_rounded_2 = Data(gross_floor_area_rounded)
core_area_rounded_2 = Data(core_area_rounded)
efficiency_2 = Data(efficiency)
move_5 = Move(Geometry=pl_3, Motion=amp_3)  # -> Geometry, Transform
move_6 = Move(Geometry=pl_4, Motion=amp_4)  # -> Geometry, Transform
flatten_2 = FlattenTree(Tree=gross_floor_area_rounded_2, Path="{0}")
flatten_3 = FlattenTree(Tree=core_area_rounded_2, Path="{0}")
flatten_4 = FlattenTree(Tree=efficiency_2, Path="{0}")
plane_x = Plane(move_5.Geometry)
plane_y = Plane(move_6.Geometry)
# Text_Planes
plan_grid_cells_2 = Curve(plan_grid_cells)
text_margin_3 = Number(text_margin_2)
initial_plane_7 = Plane(initial_plane)
ins = InsertItems(List=flatten_2, Item="GROSS_FLOOR_AREA", Indices="0", Wrap=True)
ins_2 = InsertItems(List=flatten_3, Item="CORE_AREA", Indices="0", Wrap=True)
ins_3 = InsertItems(List=flatten_4, Item="EFFICIENCY (%)", Indices="0", Wrap=True)
deplane_4 = DeconstructPlane(Plane=initial_plane_7)  # -> Origin, XAxis, YAxis, ZAxis
neg_6 = Negative(Value=text_margin_3)
# Massing_Plan_Crv_On_Grid_Sorted
massing_plan_crv_on_grid_3 = Curve(massing_plan_crv_on_grid)
program_index_3 = Data(program_index)
program_index_4 = Data(program_index)
# Core_Plan_Crv_On_Grid_Sorted
core_plan_crv_on_grid_3 = Curve(core_plan_crv_on_grid)
entwine = Entwine(Branch00=ins, Branch01=ins_2, Branch02=ins_3, FlattenInputs=True)  # -> simplify(Result)
core_plan_crv_on_grid_4 = Curve(core_plan_crv_on_grid)
plane_y_2 = Plane(plane_y)
# Hor_Dim_Pts
# Ver_Dim_Pts
massing_plan_crv_on_grid_4 = Curve(massing_plan_crv_on_grid)
plane_x_2 = Plane(plane_x)
offset = OffsetCurve(Curve=plan_grid_cells_2, Distance=neg_6, Corners=1)
group_2 = Group(Geometry=massing_plan_crv_on_grid_3)
group_3 = Group(Geometry=core_plan_crv_on_grid_3)
cp = ControlPoints(Curve=offset)  # -> Points, Weights, Knots
bang_3 = ExplodeTree(Data=entwine)  # -> Branch0, Branch1, Branch2
merge_8 = Merge(Data1=massing_plan_crv_on_grid_4, Data2=core_plan_crv_on_grid_4)
item_12 = ListItem(List=flatten(group_2), Index=program_index_3, Wrap=True)
item_13 = ListItem(List=flatten(group_3), Index=program_index_4, Wrap=True)
cull_i_3 = CullIndex(List=bang_3.Branch2, Indices="0", Wrap=True)
cull_i_4 = CullIndex(List=bang_3.Branch0, Indices="0", Wrap=True)
cull_i_5 = CullIndex(List=bang_3.Branch1, Indices="0", Wrap=True)
boundary_3 = BoundarySurfaces(Edges=merge_8)
item_14 = ListItem(List=cp.Points, Index="3", Wrap=True)
num = Number(cull_i_3)
ungroup_2 = Ungroup(Group=item_12)
num_2 = Number(cull_i_5)
ungroup_3 = Ungroup(Group=item_13)
num_3 = Number(cull_i_4)
pl_5 = ConstructPlane(Origin=item_14, XAxis=deplane_4.XAxis, YAxis=deplane_4.YAxis)
google_sheets_writer = Python3Script(
    credentials_path=credentials_path_3,
    url=url_3,
    worksheet_name=worksheet_name_3,
    cell_range=cell_range_2,
    data_tree=entwine)  # inputs credentials_path: String, url: String, worksheet_name: String, cell_range: String, data_tree: tree
# ---------- google_sheets_writer: Python ----------
#r: gspread
#r: google-api-python-client
#r: google-auth
#r: google-auth-oauthlib
#r: google-auth-httplib2
#r: requests
#r: gspread-formatting

import re
import gspread
from google.oauth2.service_account import Credentials
import gspread.utils

# Grasshopper assemblies
from Grasshopper import DataTree
from Grasshopper.Kernel.Data import GH_Path

def tree_to_matrix(tree):
    """
    Convert a Grasshopper DataTree (with Tree Access) into a 2D list (matrix) for Google Sheets.
    
    Each branch is assumed to represent one column, and the branch's items are ordered as successive rows.
    Branches are sorted by the first index in their GH_Path.
    """
    if not hasattr(tree, "Branches"):
        raise Exception("Input must be provided as a DataTree (Tree Access) with branches representing columns.")
    
    branches = tree.Branches
    branch_list = []
    for branch in branches:
        try:
            # Extract the first element of the branch's GH_Path as the column index.
            path = branch.Path
            col_index = path[0] if len(path) > 0 else 0
        except Exception:
            col_index = 0
        branch_list.append((col_index, branch))
    
    # Sort branches by the extracted column index.
    branch_list = sorted(branch_list, key=lambda x: x[0])
    sorted_branches = [b for col, b in branch_list]
    
    # Convert each branch to a list (each branch represents a column).
    columns = []
    for branch in sorted_branches:
        try:
            columns.append(list(branch))
        except Exception:
            columns.append([])
    
    # Determine the maximum number of rows among all columns.
    max_rows = max([len(col) for col in columns]) if columns else 0
    
    # Build a row-major matrix by taking the i-th element from each column.
    matrix = []
    for i in range(max_rows):
        row = []
        for col in columns:
            if i < len(col):
                row.append(col[i])
            else:
                row.append("")
        matrix.append(row)
    return matrix

# Convert the input DataTree (data_tree) to a 2D list (matrix)
matrix = tree_to_matrix(data_tree)

# --- Compute the full target range based on the provided cell_range ---
# Use the starting cell from cell_range (e.g., if cell_range is "D1:Z100", we use "D1").
if ":" in cell_range:
    start_cell = cell_range.split(":")[0]
else:
    start_cell = cell_range

# Convert the starting cell to row and column numbers.
start_row, start_col = gspread.utils.a1_to_rowcol(start_cell)
num_rows = len(matrix)
num_cols = len(matrix[0]) if num_rows > 0 else 0

# Compute the ending cell based on the matrix dimensions.
end_row = start_row + num_rows - 1
end_col = start_col + num_cols - 1
end_cell = gspread.utils.rowcol_to_a1(end_row, end_col)
full_range = f"{start_cell}:{end_cell}"

try:
    # Extract the sheet ID from the provided URL.
    match = re.search(r'/d/([a-zA-Z0-9-_]+)', url)
    if match:
        sheet_id = match.group(1)
    else:
        raise Exception("Could not extract sheet id from URL.")
    
    # Define the scope and create credentials.
    scope = ["https://spreadsheets.google.com/feeds",
             "https://www.googleapis.com/auth/drive"]
    creds = Credentials.from_service_account_file(credentials_path, scopes=scope)
    
    # Authorize the gspread client and open the worksheet.
    client = gspread.authorize(creds)
    spreadsheet = client.open_by_key(sheet_id)
    worksheet = spreadsheet.worksheet(worksheet_name)
    
    # Update the worksheet using the computed full_range and the 2D matrix.
    worksheet.update(range_name=full_range, values=matrix)
    
    result_message = f"Data successfully written to {full_range}."
    
except Exception as e:
    result_message = "Error: " + str(e)
# ---------- end google_sheets_writer ----------
sec = BrepPlane(Brep=boundary_3, Plane=plane_x_2)  # -> Curves, Points
sec_2 = BrepPlane(Brep=boundary_3, Plane=plane_y_2)  # -> Curves, Points
trim_6 = TrimTree(Tree=ungroup_2, Depth=1)
trim_7 = TrimTree(Tree=ungroup_3, Depth=1)
text_planes = Plane(pl_5)
end = EndPoints(Curve=sec.Curves)  # -> graft(Start), graft(End)
end_2 = EndPoints(Curve=sec_2.Curves)  # -> graft(Start), graft(End)
massing_plan_crv_on_grid_sorted = Curve(trim_6)
core_plan_crv_on_grid_sorted = Curve(trim_7)
hor_dim_pt_02 = Point(end.End)
ver_dim_pt_02 = Point(end_2.End)
hor_dim_pt_01 = Point(end.Start)
ver_dim_pt_01 = Point(end_2.Start)
# Text_02
text_planes_2 = Plane(text_planes)
plan_grid_column_count_4 = Number(plan_grid_column_count_2)
plan_grid_rectangle_y_size_4 = Number(plan_grid_rectangle_y_size_2)
initial_plane_8 = Plane(initial_plane)
program_name_sorted_2 = Data(program_name_sorted)
massing_plan_crv_on_grid_sorted_2 = Curve(massing_plan_crv_on_grid_sorted)
# Text_01
number_of_floors_4 = Number(eml_number_of_floors_2)
text_planes_3 = Plane(text_planes)
gross_floor_area_rounded_3 = Data(gross_floor_area_rounded)
core_area_rounded_3 = Data(core_area_rounded)
efficiency_3 = Data(efficiency)
# Hatch
# Hatch
massing_plan_crv_on_grid_sorted_3 = Curve(massing_plan_crv_on_grid_sorted)
core_plan_crv_on_grid_sorted_2 = Curve(core_plan_crv_on_grid_sorted)
# Dim_02
ver_dim_pt_01_2 = Point(ver_dim_pt_01)
ver_dim_pt_02_2 = Point(ver_dim_pt_02)
hor_dim_pt_02_2 = Point(hor_dim_pt_02)
# Dimensions
# Dim_01
hor_dim_pt_01_2 = Point(hor_dim_pt_01)
# Text
panel_3 = Panel("1")
series_8 = Series(Start=panel_3, Step=1, Count=number_of_floors_4)  # -> simplify(graft(Series))
deplane_5 = DeconstructPlane(Plane=initial_plane_8)  # -> Origin, XAxis, YAxis, ZAxis
item_15 = ListItem(List=program_name_sorted_2, Index=0, Wrap=True)
merge_9 = Merge(Data1=massing_plan_crv_on_grid_sorted_3, Data2=core_plan_crv_on_grid_sorted_2)
area_11 = Area(Geometry=massing_plan_crv_on_grid_sorted_2)  # -> Area, Centroid
boundary_4 = BoundarySurfaces(Edges=merge_9)
program_colors_sorted_2 = Data(program_colors_sorted)
as_dimension = AnnotationDimensionSettings(
    ViewOriented=True,
    TextLocation="1",
    DimensionLineExtension=Slider(0.5, range=0..1),
    ExtensionLineExtension=Slider(0, range=0..10),
    ExtensionLineOffset=Slider(0.5, range=0..1),
    SuppressExtension1=False)  # -> DimensionSettings, ViewOriented, TextLocation, TextRotation, RadialViewOriented, RadialTextLocation, RadialTextRotation, DimensionLineExtension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
as_arrows = AnnotationArrowSettings(Arrow1=4, Arrow2=4, ArrowSize=Slider(0.5, range=0..1))  # -> ArrowSettings, Arrow1, Arrow2, ArrowSize, FitArrow, DimensionInline, LeaderArrow, LeaderArrowSize
as_units = AnnotationUnitsSettings(LengthUnitsFormat="5", LinearResolution=Slider(2, range=0..10), Suffix=" m")  # -> UnitsSettings, LengthUnitsFormat, LengthFactor, LinearResolution, Roundoff, Prefix, Suffix, ZeroSuppression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
as_dimension_2 = AnnotationDimensionSettings(
    ViewOriented=True,
    TextLocation="1",
    DimensionLineExtension=Slider(0.5, range=0..1),
    ExtensionLineExtension=Slider(0, range=0..10),
    ExtensionLineOffset=Slider(0.5, range=0..1),
    SuppressExtension1=False)  # -> DimensionSettings, ViewOriented, TextLocation, TextRotation, RadialViewOriented, RadialTextLocation, RadialTextRotation, DimensionLineExtension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
as_arrows_2 = AnnotationArrowSettings(Arrow1=4, Arrow2=4, ArrowSize=Slider(0.5, range=0..1))  # -> ArrowSettings, Arrow1, Arrow2, ArrowSize, FitArrow, DimensionInline, LeaderArrow, LeaderArrowSize
as_units_2 = AnnotationUnitsSettings(LengthUnitsFormat="5", LinearResolution=Slider(2, range=0..10), Suffix=" m")  # -> UnitsSettings, LengthUnitsFormat, LengthFactor, LinearResolution, Roundoff, Prefix, Suffix, ZeroSuppression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
format_4 = Format(Format="{0:00}", Culture=127, Data0=series_8)  # -> simplify(Text)
ma_3 = MassAddition(Input=area_11.Area)  # -> Result, PartialResults
hp = HatchPattern(<hatch pattern referenced from the Rhino model>)
addition_4 = Addition(A=plan_grid_rectangle_y_size_4, B="5")
simplify = SimplifyTree(Tree=text_planes_2, Front=False)  # -> flatten(Tree)
ma_4 = MassAddition(Input=flatten(ma_3.Result))  # -> Result, PartialResults
hatch = ModelHatch(Boundary=boundary_4, HatchPattern=hp)  # -> Hatch, Boundary, Plane, HatchPattern, BasePoint, Rotation, Scale, ShowBoundary, Background, FillStyle
display_colour = DisplayColour(Colour=program_colors_sorted_2)  # -> DisplayColour, Source, Colour
round_5 = Round(Number=ma_3.Result)  # -> Nearest, Floor, Ceiling
partition_3 = PartitionList(List=simplify, Size=plan_grid_column_count_4)  # -> simplify(Chunks)
amp_5 = Amplitude(Vector=deplane_5.YAxis, Amplitude=addition_4)
display = DisplayAttributes(DisplayColour=display_colour.DisplayColour)  # -> Display, DisplayColour, DisplayMode
round_6 = Round(Number=ma_4.Result)  # -> Nearest, Floor, Ceiling
as_text = AnnotationTextSettings(TextHeight=Slider(1, range=0..1), TextGap=Slider(0.5, range=0..1), ViewOriented=True, FitText="1")  # -> TextSettings, Font, TextHeight, TextGap, MaskColour, MaskMargins, MaskFrame, ViewOriented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
as_text_2 = AnnotationTextSettings(TextHeight=Slider(1, range=0..1), TextGap=Slider(0.5, range=0..1), ViewOriented=True, FitText="1")  # -> TextSettings, Font, TextHeight, TextGap, MaskColour, MaskMargins, MaskFrame, ViewOriented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
linetype = ModelLinetype()  # -> Linetype, Name, Segments, CapStyle, JoinStyle, Width, WidthUnits
linetype_2 = ModelLinetype()  # -> Linetype, Name, Segments, CapStyle, JoinStyle, Width, WidthUnits
concat_4 = Concatenate(FragmentA="Floor Number:  ", FragmentB=format_4)
concat_5 = Concatenate(FragmentA="Gross Floor Area:  ", FragmentB=gross_floor_area_rounded_3, FragmentC=" m²")
concat_6 = Concatenate(FragmentA="Core Area:  ", FragmentB=core_area_rounded_3, FragmentC=" m²")
concat_7 = Concatenate(FragmentA="Efficiency:  ", FragmentB=efficiency_3, FragmentC="%")
tstat_7 = TreeStatistics(Tree=partition_3)  # -> Paths, Length, Count
neg_7 = Negative(Value=amp_5)
item_16 = ListItem(List=reverse(tstat_7.Paths), Index=0, Wrap=True)
object = ModelObject(Object=hatch.Hatch, Layer="02_OUTPUT::00_ANNOTATIONS::HATCH", Display=display.Display)  # -> Object, Geometry, Name, Layer, Visibility, Display, Drafting, Render
display_2 = DisplayAttributes(DisplayColour=ColourSwatch(SwatchColor=RGB(0, 0, 0)))  # -> Display, DisplayColour, DisplayMode, IsocurveDensity
display_3 = DisplayAttributes(DisplayColour=ColourSwatch(SwatchColor=RGB(0, 0, 0)))  # -> Display, DisplayColour, DisplayMode, IsocurveDensity
branch_3 = TreeBranch(Tree=partition_3, Path=item_16, MaintainPaths=True)
dimaligned = AlignedDimension(
    PointA=hor_dim_pt_01_2,
    PointB=hor_dim_pt_02_2,
    Offset="0",
    TextSettings=as_text.TextSettings,
    DimensionSettings=as_dimension.DimensionSettings,
    ArrowSettings=as_arrows.ArrowSettings,
    UnitsSettings=as_units.UnitsSettings)  # -> AlignedDimension, Plane, PointA, PointB, Offset, TextOverride, TextSettings, DimensionSettings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
drafting = DraftingAttributes(Linetype=linetype.Linetype)  # -> Drafting, Linetype, LinetypeScale
dimaligned_2 = AlignedDimension(
    PointA=ver_dim_pt_01_2,
    PointB=ver_dim_pt_02_2,
    Offset="0",
    TextSettings=as_text_2.TextSettings,
    DimensionSettings=as_dimension_2.DimensionSettings,
    ArrowSettings=as_arrows_2.ArrowSettings,
    UnitsSettings=as_units_2.UnitsSettings)  # -> AlignedDimension, Plane, PointA, PointB, Offset, TextOverride, TextSettings, DimensionSettings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
drafting_2 = DraftingAttributes(Linetype=linetype_2.Linetype)  # -> Drafting, Linetype, LinetypeScale
concat_8 = Concatenate(FragmentG=concat_4, FragmentA=concat_5, FragmentC=concat_6, FragmentE=concat_7)
concat_9 = Concatenate(FragmentA=item_15, FragmentD=" Total Area:  ", FragmentB=round_5.Nearest, FragmentC=" m²")
hatch_2 = Hatch(hatch.Hatch)
item_17 = ListItem(List=branch_3, Index=0, Wrap=True)
concat_10 = Concatenate(FragmentA="Total Building Area:  ", FragmentB=round_6.Nearest, FragmentC=" m²")
case = TextCase(Text="02_OUTPUT::00_ANNOTATIONS::DIMENSIONS::DIM_01", Culture=127)  # -> UpperCase, LowerCase
case_2 = TextCase(Text="02_OUTPUT::00_ANNOTATIONS::DIMENSIONS::DIM_02", Culture=127)  # -> UpperCase, LowerCase
text_height_3 = Number(text_height_2)
flatten_5 = FlattenTree(Tree=concat_9, Path="{0}")
object_2 = ModelObject(Object=dimaligned.AlignedDimension, Layer=case.UpperCase, Display=display_2.Display, Drafting=drafting.Drafting)  # -> Object, Geometry, Name, Layer, Visibility, Display, Drafting, Render
object_3 = ModelObject(Object=dimaligned_2.AlignedDimension, Layer=case_2.UpperCase, Display=display_3.Display, Drafting=drafting_2.Drafting)  # -> Object, Geometry, Name, Layer, Visibility, Display, Drafting, Render
move_7 = Move(Geometry=item_17, Motion=neg_7)  # -> Geometry, Transform
as_text_3 = AnnotationTextSettings(TextHeight=text_height_3, HorizontalAlignment="0", VerticalAlignment="0")  # -> TextSettings, Font, TextHeight, TextGap, MaskColour, MaskMargins, MaskFrame, ViewOriented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
df = DrawFoward()  # disabled
df_2 = DrawFoward()  # disabled
join_6 = TextJoin(Text=flatten_5)
dim_02 = ModelObject(object_3.Object)
dim_01 = ModelObject(object_2.Object)
text = TextEntity(Plane=simplify(text_planes_3), Text=concat_8, TextSettings=as_text_3.TextSettings)  # -> TextEntity, Plane, Text, TextSettings
concat_11 = Concatenate(FragmentA=join_6, FragmentC=concat_10)
pl_6 = ConstructPlane(Origin=move_7.Geometry, XAxis=deplane_5.XAxis, YAxis=deplane_5.YAxis)
text_height_4 = Number(text_height_2)
multiplication_5 = Multiplication(A=text_height_4, B="2")
object_4 = ModelObject(Object=text.TextEntity, Layer="02_OUTPUT::00_ANNOTATIONS::TEXT")  # -> Object, Geometry, Name, Layer, Visibility, Display, Drafting, Render
as_text_4 = AnnotationTextSettings(TextHeight=multiplication_5, HorizontalAlignment="0", VerticalAlignment="0")  # -> TextSettings, Font, TextHeight, TextGap, MaskColour, MaskMargins, MaskFrame, ViewOriented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
df_3 = DrawFoward()  # disabled
df_4 = DrawFoward()  # disabled
text_2 = TextEntity(Plane=pl_6, Text=concat_11, TextSettings=as_text_4.TextSettings)  # -> TextEntity, Plane, Text, TextSettings
text_01 = ModelObject(object_4.Object)
object_5 = ModelObject(Object=text_2.TextEntity, Layer="02_OUTPUT::00_ANNOTATIONS::TEXT")  # -> Object, Geometry, Name, Layer, Visibility, Display, Drafting, Render
text_02 = ModelObject(object_5.Object)
text_01_2 = ModelObject(text_01)
text_02_2 = ModelObject(text_02)
merge_10 = Merge(Data1=text_01_2, Data2=text_02_2)
eml_text = ModelObject(merge_10)
eml_dimension_01 = ModelObject(dim_01)
eml_dimension_02 = ModelObject(dim_02)
eml_core_plan_crv = Curve(core_plan_crv)
# Preview
eml_massing_brep = Brep(massing_brep)
eml_core_brep = Brep(core_brep)
eml_massing_plan_srf_sorted = Surface(massing_plan_srf_sorted)
eml_massing_plan_crv_on_grid_sorted = Curve(massing_plan_crv_on_grid_sorted)
eml_core_plan_crv_on_grid = Curve(core_plan_crv_on_grid)
eml_plan_grid_cells = Curve(plan_grid_cells)
eml_text_2 = ModelObject(eml_text)
eml_hatch = Hatch(hatch_2)
num_4 = Number(num_3)

# ---- group: ml_GROSS_FLOOR_AREA
eml_gross_floor_area = Panel(num_4)

# ----
num_5 = Number(num_2)
eml_core_area = Panel(num_5)
num_6 = Number(num)
program_colors_sorted_3 = Data(program_colors_sorted)
swatch = ColourSwatch(SwatchColor=RGB(0, 0, 0))
swatch_2 = ColourSwatch(SwatchColor=RGB(204, 204, 204))
program_colors_sorted_4 = Data(program_colors_sorted)
eml_efficiency = Panel(num_6)
preview = CustomPreview(Geometry=eml_massing_brep, Material=ColourSwatch(SwatchColor=RGBA(186, 186, 186, 150)))
preview_2 = CustomPreview(Geometry=eml_core_brep, Material=ColourSwatch(SwatchColor=RGB(84, 84, 84)))
preview_3 = CustomPreview(Geometry=eml_massing_plan_srf_sorted, Material=program_colors_sorted_4)
preview_4 = CustomPreview(Geometry=eml_massing_plan_crv_on_grid_sorted, Material=program_colors_sorted_3)
preview_5 = CustomPreview(Geometry=eml_core_plan_crv_on_grid, Material=swatch)
preview_6 = CustomPreview(Geometry=eml_plan_grid_cells, Material=swatch_2)
preview_7 = CustomPreview(Geometry=eml_text_2, Material=ColourSwatch(SwatchColor=RGB(0, 0, 0)))
preview_8 = CustomPreview(Geometry=eml_dimension_01, Material=ColourSwatch(SwatchColor=RGB(0, 0, 0)))
preview_9 = CustomPreview(Geometry=eml_dimension_02, Material=ColourSwatch(SwatchColor=RGB(0, 0, 0)))
preview_10 = CustomPreview(Geometry=eml_core_plan_crv, Material=ColourSwatch(SwatchColor=RGB(0, 0, 0)))
preview_11 = CustomPreview(Geometry=eml_hatch, Material=ColourSwatch(SwatchColor=RGB(199, 199, 199)))
# Bake
# Bake
bake = BooleanToggle(False)
bool = Boolean(bake)
# Purge/Push
bool_2 = Boolean(bool)
cull_15 = CullPattern(List="Purge", CullPattern=invert(bool_2))
cull_16 = CullPattern(List="Push", CullPattern=bool_2)
merge_11 = Merge(Data1=cull_16, Data2=cull_15)  # -> flatten(Result)
purge_push = Data(merge_11)
purge_push_2 = Data(purge_push)
cache = ContentCache(Name="HATCH", Content=object.Object, Action=purge_push_2)  # -> Name, Content, Result
purge_push_3 = Data(purge_push)
purge_push_4 = Data(purge_push)
cache_2 = ContentCache(Name="DIM_01", Content=object_2.Object, Action=purge_push_3)  # -> Name, Content, Result
cache_3 = ContentCache(Name="DIM_02", Content=object_3.Object, Action=purge_push_4)  # -> Name, Content, Result
purge_push_5 = Data(purge_push)
cache_4 = ContentCache(Name="TEXT_01", Content=object_4.Object, Action=purge_push_5)  # -> Name, Content, Result
purge_push_6 = Data(purge_push)
cache_5 = ContentCache(Name="TEXT_02", Content=object_5.Object, Action=purge_push_6)  # -> Name, Content, Result
data = Data(swatch)
core_plan_crv_2 = Curve(core_plan_crv)
# 01_FLOORS
panel_4 = Panel("Massing_Plan_Srf_Sorted")
program_colors_sorted_5 = Data(program_colors_sorted)
massing_plan_srf_sorted_2 = Surface(massing_plan_srf_sorted)
program_name_sorted_3 = Data(program_name_sorted)
case_3 = TextCase(Text=program_name_sorted_3, Culture=127)  # -> UpperCase, LowerCase
case_4 = TextCase(Text="02_OUTPUT::01_FLOORS::Core_Crv", Culture=127)  # -> UpperCase, LowerCase
concat_12 = Concatenate(FragmentA="02_OUTPUT::01_FLOORS::", FragmentB=graft(case_3.UpperCase))
layer = ModelLayer(Name=case_4.UpperCase, DisplayColour=data)  # -> Layer, Name, Hidden, Locked, DisplayColour, Material, Linetype
layer_2 = ModelLayer(Name=concat_12, DisplayColour=graft(program_colors_sorted_5))  # -> Layer, Name, Hidden, Locked, DisplayColour, Material, Linetype
object_6 = ModelObject(Geometry=core_plan_crv_2, Layer=layer.Layer)  # -> Object, Geometry, Name, Layer, Visibility, Display, Drafting, Render
object_7 = ModelObject(Geometry=graft(massing_plan_srf_sorted_2), Layer=layer_2.Layer)  # -> Object, Geometry, Name, Layer, Visibility, Display, Drafting, Render
purge_push_7 = Data(purge_push)
purge_push_8 = Data(purge_push)
cache_6 = ContentCache(Name="Core_Crv", Content=object_6.Object, Action=purge_push_7)  # -> Name, Content, Result
cache_7 = ContentCache(Name=panel_4, Content=object_7.Object, Action=purge_push_8)  # -> Name, Content, Result
# 02_PLANS
panel_5 = Panel("Massing_Plan_Crv_On_Grid_Sorted")
program_name_sorted_4 = Data(program_name_sorted)
program_colors_sorted_6 = Data(program_colors_sorted)
massing_plan_crv_on_grid_sorted_4 = Curve(massing_plan_crv_on_grid_sorted)
core_plan_crv_on_grid_5 = Curve(core_plan_crv_on_grid)
plan_grid_cells_3 = Curve(plan_grid_cells)
data_2 = Data(swatch_2)
data_3 = Data(swatch)
case_5 = TextCase(Text=program_name_sorted_4, Culture=127)  # -> UpperCase, LowerCase
case_6 = TextCase(Text="02_OUTPUT::02_PLANS::Core", Culture=127)  # -> UpperCase, LowerCase
case_7 = TextCase(Text="02_OUTPUT::02_PLANS::Plan_Grid_Cells", Culture=127)  # -> UpperCase, LowerCase
concat_13 = Concatenate(FragmentA="02_OUTPUT::02_PLANS::", FragmentB=graft(case_5.UpperCase))
layer_3 = ModelLayer(Name=case_6.UpperCase, DisplayColour=data_3)  # -> Layer, Name, Hidden, Locked, DisplayColour, Material, Linetype
layer_4 = ModelLayer(Name=case_7.UpperCase, DisplayColour=data_2)  # -> Layer, Name, Hidden, Locked, DisplayColour, Material, Linetype
layer_5 = ModelLayer(Name=concat_13, DisplayColour=graft(program_colors_sorted_6))  # -> Layer, Name, Hidden, Locked, DisplayColour, Material, Linetype
object_8 = ModelObject(Geometry=core_plan_crv_on_grid_5, Layer=layer_3.Layer)  # -> Object, Geometry, Name, Layer, Visibility, Display, Drafting, Render
object_9 = ModelObject(Geometry=plan_grid_cells_3, Layer=layer_4.Layer)  # -> Object, Geometry, Name, Layer, Visibility, Display, Drafting, Render
object_10 = ModelObject(Geometry=graft(massing_plan_crv_on_grid_sorted_4), Layer=layer_5.Layer)  # -> Object, Geometry, Name, Layer, Visibility, Display, Drafting, Render
purge_push_9 = Data(purge_push)
purge_push_10 = Data(purge_push)
purge_push_11 = Data(purge_push)
cache_8 = ContentCache(Name="Core_Plan_Crv_On_Grid", Content=object_8.Object, Action=purge_push_10)  # -> Name, Content, Result
cache_9 = ContentCache(Name="Plan_Grid_Cells", Content=object_9.Object, Action=purge_push_11)  # -> Name, Content, Result
cache_10 = ContentCache(Name=panel_5, Content=object_10.Object, Action=purge_push_9)  # -> Name, Content, Result
